# Dynamo graph Example.dyn (Dynamo 2.5.0.7460)

number = DoubleInput(0)
number_2 = DoubleInput(50)
number_3 = DoubleInput(5)
range = Range(start=number, end=number_2, step=number_3)
byCoordinates = Point.ByCoordinates(x=range, y=range)
number_slider = DoubleSlider(20, range=0..100 step 0.1)
number_slider_2 = DoubleSlider(10, range=0..100 step 0.1)
byCoordinates_2 = Point.ByCoordinates(x=number_slider, y=number_slider_2)
distanceTo = Geometry.DistanceTo(geometry=byCoordinates, other=byCoordinates_2)
number_slider_3 = DoubleSlider(2, range=0..5 step 0.5)
code_block = CodeBlock(x=distanceTo, y=number_slider_3) { x/y; }
byCenterPointRadius = Circle.ByCenterPointRadius(centerPoint=byCoordinates, radius=code_block)
byCenterPointRadius_2 = Sphere.ByCenterPointRadius(centerPoint=byCoordinates, radius=code_block)
code_block_2 = CodeBlock { 1; }
code_block_3 = CodeBlock { 1; }
code_block_4 = CodeBlock { 0; }
code_block_5 = CodeBlock(a=code_block_2, b=code_block_3, c=code_block_4) { d=Point.ByCoordinates(a,b,c); }
watch = Watch(code_block_5)
