# Dynamo graph Home.dyn (Dynamo 2.5.0.7460)

family_types = FamilyTypes("隧道构片:隧道构片")
select_model_element = DSModelElementSelection()  # 1 picked in the model
curve = CurveElement.Curve(curveElement=select_model_element)
number_slider = DoubleSlider(500, range=0..1500 step 1)
pointsAtEqualSegmentLength = Curve.PointsAtEqualSegmentLength(curve=curve, divisions=number_slider)
byPoint = FamilyInstance.ByPoint(familyType=family_types, point=pointsAtEqualSegmentLength)
