# Dynamo graph create_tunnel(grid).dyn "creat_tunnel(grid)" (Dynamo 2.5.0.7460)

# group: 导入数据
file_path = Filename("..\..\Desktop\毕业设计\revit资料\Dynamo\隧道建模初级\样例.xlsx")  # graph input
file_from_path = FileObject(path=file_path)
表名 = StringInput("try2")
importExcel = Data.ImportExcel(file=file_from_path, sheetName=表名)
restOfItems = List.RestOfItems(list=importExcel)
transpose = List.Transpose(lists=restOfItems)
d1_m = CodeBlock { 0.05; }
d2_m = CodeBlock { 0.05; }
族类型 = FamilyTypes("自适应管片:自适应管片")

code_block = CodeBlock { 16; }
getitematindex = List.GetItemAtIndex(list=transpose, index=code_block)
code_block_2 = CodeBlock { 15; }
LJK_R = List.GetItemAtIndex(list=transpose, index=code_block_2)
code_block_3 = CodeBlock { 13; }
FDK_R = List.GetItemAtIndex(list=transpose, index=code_block_3)
code_block_4 = CodeBlock { 10; }
n = List.GetItemAtIndex(list=transpose, index=code_block_4)
code_block_5 = CodeBlock { 8; }
W = List.GetItemAtIndex(list=transpose, index=code_block_5)
code_block_6 = CodeBlock { 7; }
d = List.GetItemAtIndex(list=transpose, index=code_block_6)
code_block_7 = CodeBlock { 2; }
环号 = List.GetItemAtIndex(list=transpose, index=code_block_7)
code_block_8 = CodeBlock { 1; }
环中里程 = List.GetItemAtIndex(list=transpose, index=code_block_8)
code_block_9 = CodeBlock { 3; }
X = List.GetItemAtIndex(list=transpose, index=code_block_9)
code_block_10 = CodeBlock { 4; }
Y = List.GetItemAtIndex(list=transpose, index=code_block_10)
code_block_11 = CodeBlock { 5; }
Z = List.GetItemAtIndex(list=transpose, index=code_block_11)
byCoordinates = Point.ByCoordinates(x=X, y=Y, z=Z)
code_block_12 = CodeBlock { 1; }
dropItems = List.DropItems(list=byCoordinates, amount=code_block_12)
X_2 = Point.X(point=dropItems)
code_block_13 = CodeBlock { -1; }
dropItems_2 = List.DropItems(list=byCoordinates, amount=code_block_13)
X_3 = Point.X(point=dropItems_2)
list_create = List.Create(item0=X_2, item1=X_3)
transpose_2 = List.Transpose(lists=list_create)
average = Math.Average(numbers=transpose_2)
Y_2 = Point.Y(point=dropItems)
Y_3 = Point.Y(point=dropItems_2)
list_create_2 = List.Create(item0=Y_2, item1=Y_3)
transpose_3 = List.Transpose(lists=list_create_2)
average_2 = Math.Average(numbers=transpose_3)
Z_2 = Point.Z(point=dropItems)
Z_3 = Point.Z(point=dropItems_2)
list_create_3 = List.Create(item0=Z_2, item1=Z_3)
transpose_4 = List.Transpose(lists=list_create_3)
average_3 = Math.Average(numbers=transpose_4)
byCoordinates_2 = Point.ByCoordinates(x=average, y=average_2, z=average_3)

# group: <绘制轴线>
lastItem = List.LastItem(list=byCoordinates)
lastItem_2 = List.LastItem(list=byCoordinates_2)
byTwoPoints = Vector.ByTwoPoints(start=lastItem_2, end=lastItem)
add = Point.Add(point=lastItem, vectorToAdd=byTwoPoints)
join = List.Join(list0=byCoordinates_2, list1=add)
firstItem = List.FirstItem(list=byCoordinates)
firstItem_2 = List.FirstItem(list=byCoordinates_2)
byTwoPoints_2 = Vector.ByTwoPoints(start=firstItem_2, end=firstItem)
add_2 = Point.Add(point=firstItem, vectorToAdd=byTwoPoints_2)
join_2 = List.Join(list0=add_2, list1=byCoordinates_2)
join_3 = List.Join(list0=add_2, list1=byCoordinates_2, list2=add)
X_4 = Point.X(point=join_3)
Y_4 = Point.Y(point=join_3)
Z_4 = Point.Z(point=join_3)
轴线 = CodeBlock(point=join_3) { point; }
code_block_14 = CodeBlock { -1; }
dropItems_3 = List.DropItems(list=轴线, amount=code_block_14)
code_block_15 = CodeBlock { 1; }
dropItems_4 = List.DropItems(list=轴线, amount=code_block_15)
byTwoPoints_3 = Vector.ByTwoPoints(start=dropItems_3, end=dropItems_4)
code_block_16 = CodeBlock(a=byTwoPoints_3, Delta=d1_m) { b = a.Normalized(); c=b.Scale(Delta); }
X_5 = Vector.X(vector=code_block_16.c)
Y_5 = Vector.Y(vector=code_block_16.c)
Z_5 = Vector.Z(vector=code_block_16.c)
轴线方向分割 = Python(IN[0]=join_3, IN[1]=X_4, IN[2]=Y_4, IN[3]=Z_4, IN[4]=X_5, IN[5]=Y_5, IN[6]=Z_5, IN[7]=d1_m)
# ---------- 轴线方向分割.python (93 lines) ----------
# 加载 Python Standard 和 DesignScript 库
import sys
import clr
clr.AddReference('ProtoGeometry')
from Autodesk.DesignScript.Geometry import *

clr.AddReference('DSCoreNodes')
from DSCore import *

clr.AddReference("RevitAPIUI")
from Autodesk.Revit.UI import TaskDialog

clr.AddReference("RevitAPI")
import Autodesk
from Autodesk.Revit.DB.Events import *
from Autodesk.Revit.DB import *
from math import *

clr.AddReference("RevitNodes")
import Revit
clr.ImportExtensions(Revit.Elements)
clr.ImportExtensions(Revit.GeometryConversion)

clr.AddReference("RevitServices")
import RevitServices
from RevitServices.Persistence import DocumentManager
from RevitServices.Transactions import TransactionManager

# 该节点的输入内容将存储为 IN 变量中的一个列表。

dataEnteringNode = IN
points=IN[0]
X=IN[1]
Y=IN[2]
Z=IN[3]
vector_x=IN[4]
vector_y=IN[5]
vector_z=IN[6]
d1=IN[7]
# 将代码放在该行下面

point_start=List.DropItems(points,-1)
point_end=List.DropItems(points,1)
count=List.Count(points)-1
result=[]
#计算轴线矢量
i=0
vectors=[]
Distances=[]
while i < count:
    a=List.GetItemAtIndex(point_start,i)
    b=List.GetItemAtIndex(point_end,i)
    c=Vector.ByTwoPoints(a,b)
    d=Geometry.DistanceTo(a,b)
    i=i+1
    Distances.append(d)
#分割轴线
i=0
point_xs=[]
point_ys=[]
point_zs=[]
while i < count:
   n=Distances[i] // d1
   j=1
   point_x=[]
   point_y=[]
   point_z=[]
   point_x.append(X[i])
   point_y.append(Y[i])
   point_z.append(Z[i])
   while j < n:
       dx=vector_x[i]
       dy=vector_y[i]
       dz=vector_z[i]
       xx=X[i]+j*dx
       yy=Y[i]+j*dy
       zz=Z[i]+j*dz
       point_x.append(xx)
       point_y.append(yy)
       point_z.append(zz)
       j=j+1
   point_x.append(X[i+1])
   point_y.append(Y[i+1])
   point_z.append(Z[i+1])
   point_xs.append(point_x)
   point_ys.append(point_y)
   point_zs.append(point_z)
   i=i+1
result.append(point_xs)
result.append(point_ys)
result.append(point_zs)
# 将输出内容指定给 OUT 变量。
OUT = result
# ----------------------------------------
firstItem_3 = List.FirstItem(list=轴线方向分割)
number = DoubleInput(1)
getItemAtIndex = List.GetItemAtIndex(list=轴线方向分割, index=number)
lastItem_3 = List.LastItem(list=轴线方向分割)
byCoordinates_3 = Point.ByCoordinates(x=firstItem_3, y=getItemAtIndex, z=lastItem_3)

code_block_17 = CodeBlock { 0; }
序号 = List.GetItemAtIndex(list=transpose, index=code_block_17)
code_block_18 = CodeBlock(a=序号) { b=List.Count(a); }
code_block_19 = CodeBlock(vector=code_block_16.b) { vector; }
byOriginNormal = Plane.ByOriginNormal(origin=byCoordinates_3, normal=code_block_19)
transpose_5 = List.Transpose(lists=byOriginNormal)
code_block_20 = CodeBlock { -1; }
dropItems_5 = List.DropItems(list=transpose_5, amount=code_block_20)
list_transpose_起点 = List.Transpose(lists=dropItems_5)
code_block_21 = CodeBlock { 6; }
设计直径D = List.GetItemAtIndex(list=transpose, index=code_block_21)
code_block_22 = CodeBlock(D=设计直径D) { R=D/2; }
code_block_23 = CodeBlock { 9; }
TH = List.GetItemAtIndex(list=transpose, index=code_block_23)
code_block_24 = CodeBlock(R=code_block_22, TH=TH) { R; R+TH; }
左侧外圈 = Circle.ByPlaneRadius(plane=list_transpose_起点, radius=code_block_24.out1)
code_block_25 = CodeBlock { 11; }
FWJ = List.GetItemAtIndex(list=transpose, index=code_block_25)
code_block_26 = CodeBlock(d=FWJ) { d; }
rotate = Geometry.Rotate(geometry=左侧外圈, basePlane=list_transpose_起点, degrees=code_block_26)
flatten = List.Flatten(list=rotate)
code_block_27 = CodeBlock { 12; }
FDK_L = List.GetItemAtIndex(list=transpose, index=code_block_27)
code_block_28 = CodeBlock { 14; }
LJK_L = List.GetItemAtIndex(list=transpose, index=code_block_28)
code_block_29 = CodeBlock(R_w=code_block_24.out1) { a=R_w[0]; }
python_script = Python(IN[0]=FDK_L, IN[1]=LJK_L, IN[2]=d2_m, IN[3]=code_block_29)
# ---------- python_script.python (81 lines) ----------
# 加载 Python Standard 和 DesignScript 库
import sys
import clr
import math
clr.AddReference('ProtoGeometry')
from Autodesk.DesignScript.Geometry import *

# 该节点的输入内容将存储为 IN 变量中的一个列表。
dataEnteringNode = IN
FDK_ANGELs=IN[0]
LJK_ANGLEs=IN[1]
d=IN[2]
R=IN[3]
# 将代码放在该行下面
result=[]
#数据处理
FDK_ANGEL=FDK_ANGELs[0]
LJK_ANGLE=LJK_ANGLEs[0]
BZK_ANGLE=(360-FDK_ANGEL-2*LJK_ANGLE)/3
FDK_ANGEL=FDK_ANGEL/360
LJK_ANGLE=LJK_ANGLE/360
BZK_ANGLE=BZK_ANGLE/360
dL=d/R
dl=dL/(2*math.pi)

i=dl
a=FDK_ANGEL/2
while i < a:
    result.append(i)
    i=i+dl
i=a
result.append(i)

i=a+dl
a=FDK_ANGEL/2+LJK_ANGLE
while i < a:
    result.append(i)
    i=i+dl
i=a
result.append(i)

i=a+dl
a=FDK_ANGEL/2+LJK_ANGLE+BZK_ANGLE
while i < a:
    result.append(i)
    i=i+dl
i=a
result.append(i)

i=a+dl
a=FDK_ANGEL/2+LJK_ANGLE+2*BZK_ANGLE
while i < a:
    result.append(i)
    i=i+dl
i=a
result.append(i)

i=a+dl
a=FDK_ANGEL/2+LJK_ANGLE+3*BZK_ANGLE
while i < a:
    result.append(i)
    i=i+dl
i=a
result.append(i)

i=a+dl
a=FDK_ANGEL/2+2*LJK_ANGLE+3*BZK_ANGLE
while i < a:
    result.append(i)
    i=i+dl
i=a
result.append(i)

i=a+dl
a=FDK_ANGEL+2*LJK_ANGLE+3*BZK_ANGLE
while i < a:
    result.append(i)
    i=i+dl

# 将输出内容指定给 OUT 变量。
OUT = result
# ----------------------------------------
splitByParameter = Curve.SplitByParameter(curve=flatten, parameters=python_script)
startPoint = Curve.StartPoint(curve=splitByParameter)
code_block_30 = CodeBlock { 0.5; }
pointAtParameter = Curve.PointAtParameter(curve=splitByParameter, param=code_block_30)
endPoint = Curve.EndPoint(curve=splitByParameter)
list_create_4 = List.Create(item0=startPoint, item1=pointAtParameter, item2=endPoint)
flatten_2 = List.Flatten(list=list_create_4)
code_block_31 = CodeBlock(a=flatten, b=python_script) { c=List.Count(a)*(List.Count(b)+1); }
chop = List.Chop(list=flatten_2, lengths=code_block_31)
transpose_6 = List.Transpose(lists=chop)
左侧内圈 = Circle.ByPlaneRadius(plane=list_transpose_起点, radius=code_block_24.R)
code_block_32 = CodeBlock(d=FWJ) { d; }
rotate_2 = Geometry.Rotate(geometry=左侧内圈, basePlane=list_transpose_起点, degrees=code_block_32)
flatten_3 = List.Flatten(list=rotate_2)
python_script_2 = Python(IN[0]=FDK_L, IN[1]=LJK_L, IN[2]=d2_m, IN[3]=code_block_29)  # same code as python_script
splitByParameter_2 = Curve.SplitByParameter(curve=flatten_3, parameters=python_script_2)
startPoint_2 = Curve.StartPoint(curve=splitByParameter_2)
code_block_33 = CodeBlock { 0.5; }
pointAtParameter_2 = Curve.PointAtParameter(curve=splitByParameter_2, param=code_block_33)
endPoint_2 = Curve.EndPoint(curve=splitByParameter_2)
list_create_5 = List.Create(item0=startPoint_2, item1=pointAtParameter_2, item2=endPoint_2)
flatten_4 = List.Flatten(list=list_create_5)
code_block_34 = CodeBlock(a=flatten_3, b=python_script_2) { c=List.Count(a)*(List.Count(b)+1); }
chop_2 = List.Chop(list=flatten_4, lengths=code_block_34)
transpose_7 = List.Transpose(lists=chop_2)
code_block_35 = CodeBlock { 1; }
dropItems_6 = List.DropItems(list=transpose_5, amount=code_block_35)
list_transpose_终点 = List.Transpose(lists=dropItems_6)
右侧外圈 = Circle.ByPlaneRadius(plane=list_transpose_终点, radius=code_block_24.out1)
code_block_36 = CodeBlock(d=FWJ) { d; }
rotate_3 = Geometry.Rotate(geometry=右侧外圈, basePlane=list_transpose_终点, degrees=code_block_36)
flatten_5 = List.Flatten(list=rotate_3)
python_script_3 = Python(IN[0]=FDK_L, IN[1]=LJK_L, IN[2]=d2_m, IN[3]=code_block_29)  # same code as python_script
splitByParameter_3 = Curve.SplitByParameter(curve=flatten_5, parameters=python_script_3)
startPoint_3 = Curve.StartPoint(curve=splitByParameter_3)
code_block_37 = CodeBlock { 0.5; }
pointAtParameter_3 = Curve.PointAtParameter(curve=splitByParameter_3, param=code_block_37)
endPoint_3 = Curve.EndPoint(curve=splitByParameter_3)
list_create_6 = List.Create(item0=startPoint_3, item1=pointAtParameter_3, item2=endPoint_3)
flatten_6 = List.Flatten(list=list_create_6)
code_block_38 = CodeBlock(a=flatten_5, b=python_script_3) { c=List.Count(a)*(List.Count(b)+1); }
chop_3 = List.Chop(list=flatten_6, lengths=code_block_38)
transpose_8 = List.Transpose(lists=chop_3)
右侧内圈 = Circle.ByPlaneRadius(plane=list_transpose_终点, radius=code_block_24.R)
code_block_39 = CodeBlock(d=FWJ) { d; }
rotate_4 = Geometry.Rotate(geometry=右侧内圈, basePlane=list_transpose_终点, degrees=code_block_39)
flatten_7 = List.Flatten(list=rotate_4)
python_script_4 = Python(IN[0]=FDK_L, IN[1]=LJK_L, IN[2]=d2_m, IN[3]=code_block_29)  # same code as python_script
splitByParameter_4 = Curve.SplitByParameter(curve=flatten_7, parameters=python_script_4)
startPoint_4 = Curve.StartPoint(curve=splitByParameter_4)
code_block_40 = CodeBlock { 0.5; }
pointAtParameter_4 = Curve.PointAtParameter(curve=splitByParameter_4, param=code_block_40)
endPoint_4 = Curve.EndPoint(curve=splitByParameter_4)
list_create_7 = List.Create(item0=startPoint_4, item1=pointAtParameter_4, item2=endPoint_4)
flatten_8 = List.Flatten(list=list_create_7)
code_block_41 = CodeBlock(a=flatten_7, b=python_script_4) { c=List.Count(a)*(List.Count(b)+1); }
chop_4 = List.Chop(list=flatten_8, lengths=code_block_41)
transpose_9 = List.Transpose(lists=chop_4)
python_script_5 = Python(IN[0]=transpose_6, IN[1]=transpose_7, IN[2]=transpose_8, IN[3]=transpose_9)
# ---------- python_script_5.python (28 lines) ----------
# 加载 Python Standard 和 DesignScript 库
import sys
import clr
clr.AddReference('ProtoGeometry')
from Autodesk.DesignScript.Geometry import *

clr.AddReference('DSCoreNodes')
from DSCore import *


# 该节点的输入内容将存储为 IN 变量中的一个列表。
dataEnteringNode = IN
list1=IN[0]
list2=IN[1]
list3=IN[2]
list4=IN[3]
# 将代码放在该行下面
count=List.Count(list1)
i=0
result=[]
while i < count:
    result.append(list1[i])
    result.append(list2[i])
    result.append(list3[i])
    result.append(list4[i])
    i=i+1
# 将输出内容指定给 OUT 变量。
OUT = result
# ----------------------------------------
flatten_9 = List.Flatten(list=python_script_5)
code_block_42 = CodeBlock { 12; }
chop_5 = List.Chop(list=flatten_9, lengths=code_block_42)
code_block_43 = CodeBlock { 29*380; }
dropItems_7 = List.DropItems(list=chop_5, amount=code_block_43)
code_block_44 = CodeBlock { 380; }
takeItems = List.TakeItems(list=dropItems_7, amount=code_block_44)
byPoints = AdaptiveComponent.ByPoints(points=takeItems, familyType=族类型)
