# Dynamo graph create_tunnel(grid)_bolt.dyn (Dynamo 2.5.0.7460)

# group: <数据输入>
file_path = Filename("..\..\Desktop\毕业设计\revit资料\Dynamo\隧道建模初级\样例.xlsx")  # graph input
file_from_path = FileObject(path=file_path)
表名 = StringInput("try2")
importExcel = Data.ImportExcel(file=file_from_path, sheetName=表名)
restOfItems = List.RestOfItems(list=importExcel)
transpose = List.Transpose(lists=restOfItems)
d1_m = CodeBlock { 0.15; }
d2_m = CodeBlock { 0.15; }
族类型 = FamilyTypes("自适应管片:自适应管片")

code_block = CodeBlock { 16; }
getitematindex = List.GetItemAtIndex(list=transpose, index=code_block)
code_block_2 = CodeBlock { 10; }
n = List.GetItemAtIndex(list=transpose, index=code_block_2)
code_block_3 = CodeBlock { 8; }
W = List.GetItemAtIndex(list=transpose, index=code_block_3)
code_block_4 = CodeBlock { 7; }
d = List.GetItemAtIndex(list=transpose, index=code_block_4)
code_block_5 = CodeBlock { 2; }
环号 = List.GetItemAtIndex(list=transpose, index=code_block_5)
code_block_6 = CodeBlock { 1; }
环中里程 = List.GetItemAtIndex(list=transpose, index=code_block_6)
code_block_7 = CodeBlock { 3; }
X = List.GetItemAtIndex(list=transpose, index=code_block_7)
code_block_8 = CodeBlock { 4; }
Y = List.GetItemAtIndex(list=transpose, index=code_block_8)
code_block_9 = CodeBlock { 5; }
Z = List.GetItemAtIndex(list=transpose, index=code_block_9)
byCoordinates = Point.ByCoordinates(x=X, y=Y, z=Z)
code_block_10 = CodeBlock { 1; }
dropItems = List.DropItems(list=byCoordinates, amount=code_block_10)
X_2 = Point.X(point=dropItems)
code_block_11 = CodeBlock { -1; }
dropItems_2 = List.DropItems(list=byCoordinates, amount=code_block_11)
X_3 = Point.X(point=dropItems_2)
list_create = List.Create(item0=X_2, item1=X_3)
transpose_2 = List.Transpose(lists=list_create)
average = Math.Average(numbers=transpose_2)
Y_2 = Point.Y(point=dropItems)
Y_3 = Point.Y(point=dropItems_2)
list_create_2 = List.Create(item0=Y_2, item1=Y_3)
transpose_3 = List.Transpose(lists=list_create_2)
average_2 = Math.Average(numbers=transpose_3)
Z_2 = Point.Z(point=dropItems)
Z_3 = Point.Z(point=dropItems_2)
list_create_3 = List.Create(item0=Z_2, item1=Z_3)
transpose_4 = List.Transpose(lists=list_create_3)
average_3 = Math.Average(numbers=transpose_4)
byCoordinates_2 = Point.ByCoordinates(x=average, y=average_2, z=average_3)

# group: <绘制轴线>
lastItem = List.LastItem(list=byCoordinates)
lastItem_2 = List.LastItem(list=byCoordinates_2)
byTwoPoints = Vector.ByTwoPoints(start=lastItem_2, end=lastItem)
add = Point.Add(point=lastItem, vectorToAdd=byTwoPoints)
join = List.Join(list0=byCoordinates_2, list1=add)
firstItem = List.FirstItem(list=byCoordinates)
firstItem_2 = List.FirstItem(list=byCoordinates_2)
byTwoPoints_2 = Vector.ByTwoPoints(start=firstItem_2, end=firstItem)
add_2 = Point.Add(point=firstItem, vectorToAdd=byTwoPoints_2)
join_2 = List.Join(list0=add_2, list1=byCoordinates_2)
join_3 = List.Join(list0=add_2, list1=byCoordinates_2, list2=add)
X_4 = Point.X(point=join_3)
Y_4 = Point.Y(point=join_3)
Z_4 = Point.Z(point=join_3)
轴线 = CodeBlock(point=join_3) { point; }
code_block_12 = CodeBlock { -1; }
dropItems_3 = List.DropItems(list=轴线, amount=code_block_12)
code_block_13 = CodeBlock { 1; }
dropItems_4 = List.DropItems(list=轴线, amount=code_block_13)
byTwoPoints_3 = Vector.ByTwoPoints(start=dropItems_3, end=dropItems_4)
code_block_14 = CodeBlock(a=byTwoPoints_3, Delta=d1_m) { b = a.Normalized(); c=b.Scale(Delta); }
X_5 = Vector.X(vector=code_block_14.c)
Y_5 = Vector.Y(vector=code_block_14.c)
Z_5 = Vector.Z(vector=code_block_14.c)
轴线方向分割 = Python(IN[0]=join_3, IN[1]=X_4, IN[2]=Y_4, IN[3]=Z_4, IN[4]=X_5, IN[5]=Y_5, IN[6]=Z_5, IN[7]=d1_m)
# ---------- 轴线方向分割.python (93 lines) ----------
# 加载 Python Standard 和 DesignScript 库
import sys
import clr
clr.AddReference('ProtoGeometry')
from Autodesk.DesignScript.Geometry import *

clr.AddReference('DSCoreNodes')
from DSCore import *

clr.AddReference("RevitAPIUI")
from Autodesk.Revit.UI import TaskDialog

clr.AddReference("RevitAPI")
import Autodesk
from Autodesk.Revit.DB.Events import *
from Autodesk.Revit.DB import *
from math import *

clr.AddReference("RevitNodes")
import Revit
clr.ImportExtensions(Revit.Elements)
clr.ImportExtensions(Revit.GeometryConversion)

clr.AddReference("RevitServices")
import RevitServices
from RevitServices.Persistence import DocumentManager
from RevitServices.Transactions import TransactionManager

# 该节点的输入内容将存储为 IN 变量中的一个列表。

dataEnteringNode = IN
points=IN[0]
X=IN[1]
Y=IN[2]
Z=IN[3]
vector_x=IN[4]
vector_y=IN[5]
vector_z=IN[6]
d1=IN[7]
# 将代码放在该行下面

point_start=List.DropItems(points,-1)
point_end=List.DropItems(points,1)
count=List.Count(points)-1
result=[]
#计算轴线矢量
i=0
vectors=[]
Distances=[]
while i < count:
    a=List.GetItemAtIndex(point_start,i)
    b=List.GetItemAtIndex(point_end,i)
    c=Vector.ByTwoPoints(a,b)
    d=Geometry.DistanceTo(a,b)
    i=i+1
    Distances.append(d)
#分割轴线
i=0
point_xs=[]
point_ys=[]
point_zs=[]
while i < count:
   n=Distances[i] // d1
   j=1
   point_x=[]
   point_y=[]
   point_z=[]
   point_x.append(X[i])
   point_y.append(Y[i])
   point_z.append(Z[i])
   while j < n:
       dx=vector_x[i]
       dy=vector_y[i]
       dz=vector_z[i]
       xx=X[i]+j*dx
       yy=Y[i]+j*dy
       zz=Z[i]+j*dz
       point_x.append(xx)
       point_y.append(yy)
       point_z.append(zz)
       j=j+1
   point_x.append(X[i+1])
   point_y.append(Y[i+1])
   point_z.append(Z[i+1])
   point_xs.append(point_x)
   point_ys.append(point_y)
   point_zs.append(point_z)
   i=i+1
result.append(point_xs)
result.append(point_ys)
result.append(point_zs)
# 将输出内容指定给 OUT 变量。
OUT = result
# ----------------------------------------
firstItem_3 = List.FirstItem(list=轴线方向分割)
number = DoubleInput(1)
getItemAtIndex = List.GetItemAtIndex(list=轴线方向分割, index=number)
lastItem_3 = List.LastItem(list=轴线方向分割)
byCoordinates_3 = Point.ByCoordinates(x=firstItem_3, y=getItemAtIndex, z=lastItem_3)

code_block_15 = CodeBlock(vector=code_block_14.b) { vector; }
byOriginNormal = Plane.ByOriginNormal(origin=byCoordinates_3, normal=code_block_15)
transpose_5 = List.Transpose(lists=byOriginNormal)
code_block_16 = CodeBlock { -1; }
dropItems_5 = List.DropItems(list=transpose_5, amount=code_block_16)
list_transpose_起点 = List.Transpose(lists=dropItems_5)
code_block_17 = CodeBlock { 6; }
设计直径D = List.GetItemAtIndex(list=transpose, index=code_block_17)
code_block_18 = CodeBlock(D=设计直径D) { R=D/2; }
code_block_19 = CodeBlock { 9; }
TH = List.GetItemAtIndex(list=transpose, index=code_block_19)
code_block_20 = CodeBlock(R=code_block_18, TH=TH) { R; R+TH; }
左侧外圈 = Circle.ByPlaneRadius(plane=list_transpose_起点, radius=code_block_20.out1)
code_block_21 = CodeBlock { 11; }
FWJ = List.GetItemAtIndex(list=transpose, index=code_block_21)
code_block_22 = CodeBlock(d=FWJ) { d; }
rotate = Geometry.Rotate(geometry=左侧外圈, basePlane=list_transpose_起点, degrees=code_block_22)
transpose_6 = List.Transpose(lists=rotate)
code_block_23 = CodeBlock { 12; }
FDK_L = List.GetItemAtIndex(list=transpose, index=code_block_23)
code_block_24 = CodeBlock { 13; }
FDK_R = List.GetItemAtIndex(list=transpose, index=code_block_24)
code_block_25 = CodeBlock { 14; }
LJK_L = List.GetItemAtIndex(list=transpose, index=code_block_25)
code_block_26 = CodeBlock { 15; }
LJK_R = List.GetItemAtIndex(list=transpose, index=code_block_26)
firstItem_4 = List.FirstItem(list=byOriginNormal)

# group: <分割参数>
code_block_27 = CodeBlock(a=FDK_L, b=FDK_R, c=LJK_L, d=LJK_R) { FDK_L=List.FirstItem(a); FDK_R=List.FirstItem(b); LJK_L=List.FirstItem(c); LJK_R=List.FirstItem(d); }
单个环平面数 = List.Count(list=firstItem_4)
d2 = CodeBlock(d2=d2_m) { d2; }
外圆半径 = CodeBlock(R_w=code_block_20.out1) { a=R_w[0]; }

code_block_28 = CodeBlock { 0.5; }
左侧内圈 = Circle.ByPlaneRadius(plane=list_transpose_起点, radius=code_block_20.R)
code_block_29 = CodeBlock(d=FWJ) { d; }
rotate_2 = Geometry.Rotate(geometry=左侧内圈, basePlane=list_transpose_起点, degrees=code_block_29)
transpose_7 = List.Transpose(lists=rotate_2)
code_block_30 = CodeBlock { 0.5; }
code_block_31 = CodeBlock { 1; }
dropItems_6 = List.DropItems(list=transpose_5, amount=code_block_31)
list_transpose_终点 = List.Transpose(lists=dropItems_6)
右侧外圈 = Circle.ByPlaneRadius(plane=list_transpose_终点, radius=code_block_20.out1)
code_block_32 = CodeBlock(d=FWJ) { d; }
rotate_3 = Geometry.Rotate(geometry=右侧外圈, basePlane=list_transpose_终点, degrees=code_block_32)
transpose_8 = List.Transpose(lists=rotate_3)
code_block_33 = CodeBlock { 0.5; }
右侧内圈 = Circle.ByPlaneRadius(plane=list_transpose_终点, radius=code_block_20.R)
code_block_34 = CodeBlock(d=FWJ) { d; }
rotate_4 = Geometry.Rotate(geometry=右侧内圈, basePlane=list_transpose_终点, degrees=code_block_34)
transpose_9 = List.Transpose(lists=rotate_4)
code_block_35 = CodeBlock { 0.5; }
code_block_36 = CodeBlock { 0; }
序号 = List.GetItemAtIndex(list=transpose, index=code_block_36)
code_block_37 = CodeBlock(a=序号) { b=List.Count(a); }
file_path_2 = Filename("..\输出数据\分割参数.xlsx")  # frozen
string = StringInput("Sheet5")  # frozen
code_block_38 = CodeBlock { 0; }  # frozen

# group: <分割参数>
楔形块1_右侧 = Python(IN[0]=code_block_27.FDK_L, IN[1]=code_block_27.FDK_R, IN[2]=code_block_27.LJK_L, IN[3]=code_block_27.LJK_R, IN[4]=单个环平面数, IN[5]=d2, IN[6]=外圆半径)
# ---------- 楔形块1_右侧.python (41 lines) ----------
# 加载 Python Standard 和 DesignScript 库
import sys
import clr
import math
clr.AddReference('ProtoGeometry')
from Autodesk.DesignScript.Geometry import *

# 该节点的输入内容将存储为 IN 变量中的一个列表。
dataEnteringNode = IN
FDK_L=IN[0]
FDK_R=IN[1]
LJK_L=IN[2]
LJK_R=IN[3]
count=IN[4]-1
d=IN[5]
R=IN[6]
result=[]
# 将代码放在该行下面
BZK=(360-FDK_L-2*LJK_L)/3
FDK_L=FDK_L/360
FDK_R=FDK_R/360
LJK_L=LJK_L/360
LJK_R=LJK_R/360
BZK=BZK/360
ll=(FDK_L/2-FDK_R/2)/count
dL=d/R
dl=dL/(2*math.pi)

i=FDK_L/2-ll
while i > FDK_R/2-ll+0.000001:
    ab=[]
    a=i
    i=i-ll
    j=dl
    while j < a:
        ab.append(j)
        j=j+dl
    ab.append(a)
    result.append(ab)
# 将输出内容指定给 OUT 变量。
OUT = result
# ----------------------------------------
楔形块2_右侧 = Python(IN[0]=code_block_27.FDK_L, IN[1]=code_block_27.FDK_R, IN[2]=code_block_27.LJK_L, IN[3]=code_block_27.LJK_R, IN[4]=单个环平面数, IN[5]=d2, IN[6]=外圆半径)
# ---------- 楔形块2_右侧.python (39 lines) ----------
# 加载 Python Standard 和 DesignScript 库
import sys
import clr
import math
clr.AddReference('ProtoGeometry')
from Autodesk.DesignScript.Geometry import *

# 该节点的输入内容将存储为 IN 变量中的一个列表。
dataEnteringNode = IN
FDK_L=IN[0]
FDK_R=IN[1]
LJK_L=IN[2]
LJK_R=IN[3]
count=IN[4]-1
d=IN[5]
R=IN[6]
result=[]
# 将代码放在该行下面
BZK=(360-FDK_L-2*LJK_L)/3
FDK_L=FDK_L/360
FDK_R=FDK_R/360
LJK_L=LJK_L/360
LJK_R=LJK_R/360
BZK=BZK/360
ll=(FDK_L/2-FDK_R/2)/count
dL=d/R
dl=dL/(2*math.pi)

i=1-FDK_L/2+ll
while i < 1-FDK_R/2+ll-0.000001:
    ab=[]
    j=i
    i=i+ll
    while j < 1:
        ab.append(j)
        j=j+dl
    result.append(ab)
# 将输出内容指定给 OUT 变量。
OUT = result
# ----------------------------------------

# group: <分割参数>
楔形块1_左侧 = Python(IN[0]=code_block_27.FDK_L, IN[1]=code_block_27.FDK_R, IN[2]=code_block_27.LJK_L, IN[3]=code_block_27.LJK_R, IN[4]=单个环平面数, IN[5]=d2, IN[6]=外圆半径, IN[7]=楔形块1_右侧)
# ---------- 楔形块1_左侧.python (49 lines) ----------
# 加载 Python Standard 和 DesignScript 库
import sys
import clr
import math
clr.AddReference('ProtoGeometry')
from Autodesk.DesignScript.Geometry import *
clr.AddReference('DSCoreNodes')
from DSCore import *
# 该节点的输入内容将存储为 IN 变量中的一个列表。
dataEnteringNode = IN
FDK_L=IN[0]
FDK_R=IN[1]
LJK_L=IN[2]
LJK_R=IN[3]
count=IN[4]-1
d=IN[5]
R=IN[6]
limits=IN[7]
result=[]
# 将代码放在该行下面
BZK=(360-FDK_L-2*LJK_L)/3
FDK_L=FDK_L/360
FDK_R=FDK_R/360
LJK_L=LJK_L/360
LJK_R=LJK_R/360
BZK=BZK/360
ll=(FDK_L/2-FDK_R/2)/count
dL=d/R
dl=dL/(2*math.pi)

i=FDK_L/2
k=0
while i > FDK_R/2+0.000001:
    ab=[]
    a=i
    i=i-ll
    j=dl
    limit=limits[k]
    limit_count=List.Count(limit)
    k=k+1
    while j < a:
        length=List.Count(ab)
        if length < limit_count-1:
            ab.append(j)
        j=j+dl
    ab.append(a)
    result.append(ab)
# 将输出内容指定给 OUT 变量。
OUT = result
# ----------------------------------------
邻接块_标准块 = Python(IN[0]=code_block_27.FDK_L, IN[1]=code_block_27.FDK_R, IN[2]=code_block_27.LJK_L, IN[3]=code_block_27.LJK_R, IN[4]=单个环平面数, IN[5]=d2, IN[6]=外圆半径)
# ---------- 邻接块_标准块.python (81 lines) ----------
# 加载 Python Standard 和 DesignScript 库
import sys
import clr
import math
clr.AddReference('ProtoGeometry')
from Autodesk.DesignScript.Geometry import *

# 该节点的输入内容将存储为 IN 变量中的一个列表。
dataEnteringNode = IN
FDK_L=IN[0]
FDK_R=IN[1]
LJK_L=IN[2]
LJK_R=IN[3]
count=IN[4]-1
d=IN[5]
R=IN[6]
result=[]
# 将代码放在该行下面
BZK=(360-FDK_L-2*LJK_L)/3
FDK_L=FDK_L/360
FDK_R=FDK_R/360
LJK_L=LJK_L/360
LJK_R=LJK_R/360
BZK=BZK/360
ll=(FDK_L/2-FDK_R/2)/count
dL=d/R
dl=dL/(2*math.pi)

i=FDK_L/2
while i > FDK_R/2+0.000001:
    ab=[]
    abljk_1=[]
    abljk_2=[]
    abbzk_1=[]
    abbzk_2=[]
    abbzk_3=[]
    #LJK_1
    a=FDK_L/2+LJK_L
    j=dl+i
    while j < a:
        abljk_1.append(j)
        j=j+dl
    abljk_1.append(a)
    ab.append(abljk_1)
    #BZK_1
    j=a+dl
    a=a+BZK
    while j < a:
        abbzk_1.append(j)
        j=j+dl
    abbzk_1.append(a)
    ab.append(abbzk_1)
    #BZK_2
    j=a+dl
    a=a+BZK
    while j < a:
        abbzk_2.append(j)
        j=j+dl
    abbzk_2.append(a)
    ab.append(abbzk_2)    
    #BZK_3
    j=a+dl
    a=a+BZK
    while j < a:
        abbzk_3.append(j)
        j=j+dl
    abbzk_3.append(a)
    ab.append(abbzk_3) 
    #LJK_2
    j=a+dl
    a=1-i
    while j < a:
        abljk_2.append(j)
        j=j+dl
    #abljk_2.append(a)
    ab.append(abljk_2)
    #end
    i=i-ll    
    result.append(ab)
# 将输出内容指定给 OUT 变量。
OUT = result
# ----------------------------------------
python_script = Python(IN[0]=邻接块_标准块)
# ---------- python_script.python (22 lines) ----------
# 加载 Python Standard 和 DesignScript 库
import sys
import clr
import math
clr.AddReference('ProtoGeometry')
from Autodesk.DesignScript.Geometry import *
clr.AddReference('DSCoreNodes')
from DSCore import *
# 该节点的输入内容将存储为 IN 变量中的一个列表。
dataEnteringNode = IN
data=IN[0]
result=[]
# 将代码放在该行下面
count=List.Count(data)
i=0
while i < count:
    a=data[i]
    b=List.Flatten(a)
    result.append(b)
    i=i+1
# 将输出内容指定给 OUT 变量。
OUT = result
# ----------------------------------------
楔形块2_左侧 = Python(IN[0]=code_block_27.FDK_L, IN[1]=code_block_27.FDK_R, IN[2]=code_block_27.LJK_L, IN[3]=code_block_27.LJK_R, IN[4]=单个环平面数, IN[5]=d2, IN[6]=外圆半径, IN[7]=楔形块2_右侧)
# ---------- 楔形块2_左侧.python (47 lines) ----------
# 加载 Python Standard 和 DesignScript 库
import sys
import clr
import math
clr.AddReference('ProtoGeometry')
from Autodesk.DesignScript.Geometry import *
clr.AddReference('DSCoreNodes')
from DSCore import *
# 该节点的输入内容将存储为 IN 变量中的一个列表。
dataEnteringNode = IN
FDK_L=IN[0]
FDK_R=IN[1]
LJK_L=IN[2]
LJK_R=IN[3]
count=IN[4]-1
d=IN[5]
R=IN[6]
limits=IN[7]
result=[]
# 将代码放在该行下面
BZK=(360-FDK_L-2*LJK_L)/3
FDK_L=FDK_L/360
FDK_R=FDK_R/360
LJK_L=LJK_L/360
LJK_R=LJK_R/360
BZK=BZK/360
ll=(FDK_L/2-FDK_R/2)/count
dL=d/R
dl=dL/(2*math.pi)

i=1-FDK_L/2
k=0
while i < 1-FDK_R/2-0.000001:
    ab=[]
    j=i
    i=i+ll
    limit=limits[k]
    limit_count=List.Count(limit)
    k=k+1
    while j < 1:
        length=List.Count(ab)
        if length < limit_count:
            ab.append(j)
        j=j+dl
    result.append(ab)
# 将输出内容指定给 OUT 变量。
OUT = result
# ----------------------------------------
python_script_2 = Python(IN[0]=楔形块1_左侧, IN[1]=python_script, IN[2]=楔形块2_左侧)
# ---------- python_script_2.python (30 lines) ----------
# 加载 Python Standard 和 DesignScript 库
import sys
import clr
import math
clr.AddReference('ProtoGeometry')
from Autodesk.DesignScript.Geometry import *
clr.AddReference('DSCoreNodes')
from DSCore import *
# 该节点的输入内容将存储为 IN 变量中的一个列表。
dataEnteringNode = IN
a=IN[0]
b=IN[1]
c=IN[2]
# 将代码放在该行下面
count=List.Count(a)
i=0
result=[]
while i < count:
    d=[]
    a1=a[i]
    b1=b[i]
    c1=c[i]
    d.append(a1)
    d.append(b1)
    d.append(c1)
    d=List.Flatten(d)
    i=i+1
    result.append(d)
# 将输出内容指定给 OUT 变量。
OUT = result
# ----------------------------------------

splitByParameter = Curve.SplitByParameter(curve=transpose_6, parameters=python_script_2)
transpose_10 = List.Transpose(lists=splitByParameter)
flatten = List.Flatten(list=transpose_10)
startPoint = Curve.StartPoint(curve=flatten)
pointAtParameter = Curve.PointAtParameter(curve=flatten, param=code_block_28)
endPoint = Curve.EndPoint(curve=flatten)
list_create_4 = List.Create(item0=startPoint, item1=pointAtParameter, item2=endPoint)
transpose_11 = List.Transpose(lists=list_create_4)
splitByParameter_2 = Curve.SplitByParameter(curve=transpose_7, parameters=python_script_2)
transpose_12 = List.Transpose(lists=splitByParameter_2)
flatten_2 = List.Flatten(list=transpose_12)
startPoint_2 = Curve.StartPoint(curve=flatten_2)
pointAtParameter_2 = Curve.PointAtParameter(curve=flatten_2, param=code_block_30)
endPoint_2 = Curve.EndPoint(curve=flatten_2)
list_create_5 = List.Create(item0=startPoint_2, item1=pointAtParameter_2, item2=endPoint_2)
transpose_13 = List.Transpose(lists=list_create_5)

# group (continued): <分割参数>
邻接块_标准块_2 = Python(IN[0]=code_block_27.FDK_L, IN[1]=code_block_27.FDK_R, IN[2]=code_block_27.LJK_L, IN[3]=code_block_27.LJK_R, IN[4]=单个环平面数, IN[5]=d2, IN[6]=外圆半径, IN[7]=邻接块_标准块)
# ---------- 邻接块_标准块_2.python (94 lines) ----------
# 加载 Python Standard 和 DesignScript 库
import sys
import clr
import math
clr.AddReference('ProtoGeometry')
from Autodesk.DesignScript.Geometry import *
clr.AddReference('DSCoreNodes')
from DSCore import *
# 该节点的输入内容将存储为 IN 变量中的一个列表。
dataEnteringNode = IN
FDK_L=IN[0]
FDK_R=IN[1]
LJK_L=IN[2]
LJK_R=IN[3]
count=IN[4]-1
d=IN[5]
R=IN[6]
limits=IN[7]
result=[]
# 将代码放在该行下面
BZK=(360-FDK_L-2*LJK_L)/3
FDK_L=FDK_L/360
FDK_R=FDK_R/360
LJK_L=LJK_L/360
LJK_R=LJK_R/360
BZK=BZK/360
ll=(FDK_L/2-FDK_R/2)/count
dL=d/R
dl=dL/(2*math.pi)

k=0
i=FDK_L/2-ll
while i > FDK_R/2-ll+0.000001:
    ab=[]
    abljk_1=[]
    abljk_2=[]
    abbzk_1=[]
    abbzk_2=[]
    abbzk_3=[]
    #LJK_1
    a=FDK_L/2+LJK_L
    j=dl+i
    limit=limits[k]
    limit1=limit[0]
    limit_count1=List.Count(limit1)
    while j < a:
        length=List.Count(abljk_1)
        if length < limit_count1-1:
            abljk_1.append(j)
        j=j+dl
    abljk_1.append(a)
    ab.append(abljk_1)
    #BZK_1
    j=a+dl
    a=a+BZK
    while j < a:
        abbzk_1.append(j)
        j=j+dl
    abbzk_1.append(a)
    ab.append(abbzk_1)
    #BZK_2
    j=a+dl
    a=a+BZK
    while j < a:
        abbzk_2.append(j)
        j=j+dl
    abbzk_2.append(a)
    ab.append(abbzk_2)    
    #BZK_3
    j=a+dl
    a=a+BZK
    while j < a:
        abbzk_3.append(j)
        j=j+dl
    abbzk_3.append(a)
    ab.append(abbzk_3) 
    #LJK_2
    j=a+dl
    a=1-i
    limit2=limit[4]
    limit_count2=List.Count(limit2)
    while j < a:
        length=List.Count(abljk_2)
        if length < limit_count2:
            abljk_2.append(j)
        j=j+dl
    #abljk_2.append(a)
    ab.append(abljk_2)
    #end
    k=k+1
    i=i-ll    
    result.append(ab)
# 将输出内容指定给 OUT 变量。
OUT = result
# ----------------------------------------
python_script_3 = Python(IN[0]=邻接块_标准块_2)  # same code as python_script
python_script_4 = Python(IN[0]=楔形块1_右侧, IN[1]=python_script_3, IN[2]=楔形块2_右侧)  # same code as python_script_2

splitByParameter_3 = Curve.SplitByParameter(curve=transpose_8, parameters=python_script_4)
transpose_14 = List.Transpose(lists=splitByParameter_3)
flatten_3 = List.Flatten(list=transpose_14)
startPoint_3 = Curve.StartPoint(curve=flatten_3)
pointAtParameter_3 = Curve.PointAtParameter(curve=flatten_3, param=code_block_33)
endPoint_3 = Curve.EndPoint(curve=flatten_3)
list_create_6 = List.Create(item0=startPoint_3, item1=pointAtParameter_3, item2=endPoint_3)
transpose_15 = List.Transpose(lists=list_create_6)
splitByParameter_4 = Curve.SplitByParameter(curve=transpose_9, parameters=python_script_4)
transpose_16 = List.Transpose(lists=splitByParameter_4)
flatten_4 = List.Flatten(list=transpose_16)
startPoint_4 = Curve.StartPoint(curve=flatten_4)
pointAtParameter_4 = Curve.PointAtParameter(curve=flatten_4, param=code_block_35)
endPoint_4 = Curve.EndPoint(curve=flatten_4)
list_create_7 = List.Create(item0=startPoint_4, item1=pointAtParameter_4, item2=endPoint_4)
transpose_17 = List.Transpose(lists=list_create_7)

# group: <创建隧道>
python_script_5 = Python(IN[0]=transpose_11, IN[1]=transpose_13, IN[2]=transpose_15, IN[3]=transpose_17)
# ---------- python_script_5.python (28 lines) ----------
# 加载 Python Standard 和 DesignScript 库
import sys
import clr
clr.AddReference('ProtoGeometry')
from Autodesk.DesignScript.Geometry import *

clr.AddReference('DSCoreNodes')
from DSCore import *


# 该节点的输入内容将存储为 IN 变量中的一个列表。
dataEnteringNode = IN
list1=IN[0]
list2=IN[1]
list3=IN[2]
list4=IN[3]
# 将代码放在该行下面
count=List.Count(list1)
i=0
result=[]
while i < count:
    result.append(list1[i])
    result.append(list2[i])
    result.append(list3[i])
    result.append(list4[i])
    i=i+1
# 将输出内容指定给 OUT 变量。
OUT = result
# ----------------------------------------
flatten_5 = List.Flatten(list=python_script_5)
code_block_39 = CodeBlock { 12; }
chop = List.Chop(list=flatten_5, lengths=code_block_39)
code_block_40 = CodeBlock(points=flatten_3, n=code_block_37) { N=List.Count(points); a=N/n; }
dropItems_7 = List.DropItems(list=chop, amount=code_block_40.a)
takeItems = List.TakeItems(list=chop, amount=code_block_40.a)
byPoints = AdaptiveComponent.ByPoints(points=takeItems, familyType=族类型)

# group: <螺栓孔>
code_block_41 = CodeBlock(a=byCoordinates_3) { A=List.FirstItem(a); aa=List.FirstItem(A); }
faces = Element.Faces(element=byPoints)
螺栓序号 = CodeBlock { 631; }
getItemAtIndex_2 = List.GetItemAtIndex(list=faces, index=螺栓序号)
code_block_42 = CodeBlock { 2; }
getItemAtIndex_3 = List.GetItemAtIndex(list=getItemAtIndex_2, index=code_block_42)
code_block_43 = CodeBlock { 0.5; }
code_block_44 = CodeBlock { 0.5; }
pointAtParameter_5 = Surface.PointAtParameter(surface=getItemAtIndex_3, u=code_block_43, v=code_block_44)
code_block_45 = CodeBlock { 4; }
getItemAtIndex_4 = List.GetItemAtIndex(list=getItemAtIndex_2, index=code_block_45)
code_block_46 = CodeBlock { 0.5; }
code_block_47 = CodeBlock { 0.5; }
pointAtParameter_6 = Surface.PointAtParameter(surface=getItemAtIndex_4, u=code_block_46, v=code_block_47)
byTwoPoints_4 = Vector.ByTwoPoints(start=pointAtParameter_6, end=pointAtParameter_5)
code_block_48 = CodeBlock(a=byTwoPoints_4) { b=Vector.Scale(a,1); c=Vector.Scale(a,-1); }
add_3 = Point.Add(point=pointAtParameter_5, vectorToAdd=code_block_48.b)
code_block_49 = CodeBlock { 0.02; }
byCenterPointRadiusNormal = Circle.ByCenterPointRadiusNormal(centerPoint=add_3, radius=code_block_49, normal=code_block_48.b)
add_4 = Point.Add(point=pointAtParameter_6, vectorToAdd=code_block_48.c)
code_block_50 = CodeBlock { 0.02; }
byCenterPointRadiusNormal_2 = Circle.ByCenterPointRadiusNormal(centerPoint=add_4, radius=code_block_50, normal=code_block_48.c)
join_4 = List.Join(list0=byCenterPointRadiusNormal, list1=byCenterPointRadiusNormal_2)
byLoft = Solid.ByLoft(crossSections=join_4)  # frozen
file_path_3 = Filename("..\螺栓1.sat")
exportToSAT = ExportWithUnits(geometry=byLoft, filePath=file_path_3, SelectedExportedUnitsSource=[0, 1, 2, 3, 5, 4], SelectedExportedUnit=5)
getItemAtIndex_5 = List.GetItemAtIndex(list=byPoints, index=螺栓序号)
solids = Element.Solids(element=getItemAtIndex_5)
python_script_6 = Python(IN[0]=solids)
# ---------- python_script_6.python (12 lines) ----------
# 加载 Python Standard 和 DesignScript 库
import sys
import clr
clr.AddReference('ProtoGeometry')
from Autodesk.DesignScript.Geometry import *

# 该节点的输入内容将存储为 IN 变量中的一个列表。
dataEnteringNode = IN
a=IN[0]
# 将代码放在该行下面
# 将输出内容指定给 OUT 变量。
OUT = a[2]
# ----------------------------------------
select_model_element = DSModelElementSelection()  # 1 picked in the model; frozen
solids_2 = Element.Solids(element=select_model_element)
differenceAll = Solid.DifferenceAll(solid=python_script_6, others=solids_2)
file_path_4 = Filename("..\螺栓孔2.sat")
exportToSAT_2 = ExportWithUnits(geometry=differenceAll, filePath=file_path_4, SelectedExportedUnitsSource=[0, 1, 2, 3, 5, 4], SelectedExportedUnit=5)
获取螺栓序号 = Python(IN[0]=python_script, IN[1]=单个环平面数, IN[2]=python_script_2, IN[3]=transpose_16)
# ---------- 获取螺栓序号.python (56 lines) ----------
# 加载 Python Standard 和 DesignScript 库
import sys
import clr
import math
clr.AddReference('ProtoGeometry')
from Autodesk.DesignScript.Geometry import *
clr.AddReference('DSCoreNodes')
from DSCore import *
# 该节点的输入内容将存储为 IN 变量中的一个列表。
dataEnteringNode = IN
point_mid=IN[0]
count=IN[1]
pointss=IN[2]
curvess=IN[3]
result=[]
# 将代码放在该行下面
n=count//2-1
end=0
i=0
curves=List.FirstItem(curvess)
while i < n:
    curve=curves[i]
    end=end+List.Count(curve)
    i=i+1
result.append(end+1)

point_m=point_mid[n]
start=List.FirstItem(point_m)
endd=List.LastItem(point_m)
points=pointss[n]
count_g=List.Count(points)
j=0
while j < count_g:    
    if points[j] == start:
        a=j
    elif points[j] == endd:
        f=j
    j=j+1
b=24
c=51
d=77
e=103

g1=(a+b)//2+end
g2=(b+c)//2+end
g3=(c+d)//2+end
g4=(d+e)//2+end+2
g5=(e+f)//2+end-1
result.append(g1)
result.append(g2)
result.append(g3)
result.append(g4)
result.append(g5)

# 将输出内容指定给 OUT 变量。
OUT = result
# ----------------------------------------

exportExcel = Data.ExportExcel(filePath=file_path_2, sheetName=string, startRow=code_block_38, startCol=code_block_38, data=邻接块_标准块)  # frozen
