# Dynamo graph create_tunnel.dyn (Dynamo 2.5.0.7460)

file_path = Filename("..\Desktop\毕业设计\revit资料\Dynamo\隧道建模初级\样例.xlsx")  # graph input
file_from_path = FileObject(path=file_path)
string = StringInput("try1")
importExcel = Data.ImportExcel(file=file_from_path, sheetName=string)
restOfItems = List.RestOfItems(list=importExcel)
transpose = List.Transpose(lists=restOfItems)
code_block = CodeBlock { 0; }
序号 = List.GetItemAtIndex(list=transpose, index=code_block)
code_block_2 = CodeBlock { 1; }
环中里程 = List.GetItemAtIndex(list=transpose, index=code_block_2)
code_block_3 = CodeBlock { 2; }
环号 = List.GetItemAtIndex(list=transpose, index=code_block_3)
code_block_4 = CodeBlock { 7; }
d = List.GetItemAtIndex(list=transpose, index=code_block_4)
code_block_5 = CodeBlock { 8; }
W = List.GetItemAtIndex(list=transpose, index=code_block_5)
code_block_6 = CodeBlock { 10; }
n = List.GetItemAtIndex(list=transpose, index=code_block_6)
code_block_7 = CodeBlock { 3; }
X = List.GetItemAtIndex(list=transpose, index=code_block_7)
code_block_8 = CodeBlock { 4; }
Y = List.GetItemAtIndex(list=transpose, index=code_block_8)
code_block_9 = CodeBlock { 5; }
Z = List.GetItemAtIndex(list=transpose, index=code_block_9)
byCoordinates = Point.ByCoordinates(x=X, y=Y, z=Z)
code_block_10 = CodeBlock { 1; }
dropItems = List.DropItems(list=byCoordinates, amount=code_block_10)
X_2 = Point.X(point=dropItems)
code_block_11 = CodeBlock { -1; }
dropItems_2 = List.DropItems(list=byCoordinates, amount=code_block_11)
X_3 = Point.X(point=dropItems_2)
list_create = List.Create(item0=X_2, item1=X_3)
transpose_2 = List.Transpose(lists=list_create)
average = Math.Average(numbers=transpose_2)
Y_2 = Point.Y(point=dropItems)
Y_3 = Point.Y(point=dropItems_2)
list_create_2 = List.Create(item0=Y_2, item1=Y_3)
transpose_3 = List.Transpose(lists=list_create_2)
average_2 = Math.Average(numbers=transpose_3)
Z_2 = Point.Z(point=dropItems)
Z_3 = Point.Z(point=dropItems_2)
list_create_3 = List.Create(item0=Z_2, item1=Z_3)
transpose_4 = List.Transpose(lists=list_create_3)
average_3 = Math.Average(numbers=transpose_4)
byCoordinates_2 = Point.ByCoordinates(x=average, y=average_2, z=average_3)

# group: <绘制轴线>
firstItem = List.FirstItem(list=byCoordinates)
firstItem_2 = List.FirstItem(list=byCoordinates_2)
byTwoPoints = Vector.ByTwoPoints(start=firstItem_2, end=firstItem)
add = Point.Add(point=firstItem, vectorToAdd=byTwoPoints)
lastItem = List.LastItem(list=byCoordinates)
lastItem_2 = List.LastItem(list=byCoordinates_2)
byTwoPoints_2 = Vector.ByTwoPoints(start=lastItem_2, end=lastItem)
add_2 = Point.Add(point=lastItem, vectorToAdd=byTwoPoints_2)
join = List.Join(list0=add, list1=byCoordinates_2, list2=add_2)
byPoints = PolyCurve.ByPoints(points=join)
join_2 = List.Join(list0=add, list1=byCoordinates_2)
join_3 = List.Join(list0=byCoordinates_2, list1=add_2)

parameterAtPoint = Curve.ParameterAtPoint(curve=byPoints, point=join_2)
planeAtParameter = Curve.PlaneAtParameter(curve=byPoints, param=parameterAtPoint)
code_block_12 = CodeBlock { 6; }
设计直径D = List.GetItemAtIndex(list=transpose, index=code_block_12)
code_block_13 = CodeBlock(D=设计直径D) { D/2; }
code_block_14 = CodeBlock { 9; }
TH = List.GetItemAtIndex(list=transpose, index=code_block_14)
code_block_15 = CodeBlock(R=code_block_13, TH=TH) { R+TH; }
byPlaneRadius = Circle.ByPlaneRadius(plane=planeAtParameter, radius=code_block_15)
code_block_16 = CodeBlock { 11; }
FWJ = List.GetItemAtIndex(list=transpose, index=code_block_16)
code_block_17 = CodeBlock(d=FWJ) { d; }
rotate = Geometry.Rotate(geometry=byPlaneRadius, basePlane=planeAtParameter, degrees=code_block_17)
code_block_18 = CodeBlock { 12; }
FDK_L = List.GetItemAtIndex(list=transpose, index=code_block_18)
code_block_19 = CodeBlock { 14; }
LJK_L = List.GetItemAtIndex(list=transpose, index=code_block_19)
code_block_20 = CodeBlock(FDK_ANGEL=FDK_L, LJK_ANGLE=LJK_L)
# ---------- code_block_20.designscript (7 lines) ----------
BZK_ANGLE=(360-FDK_ANGEL-2*LJK_ANGLE)/3;
[FDK_ANGEL/2,
FDK_ANGEL/2+LJK_ANGLE,
FDK_ANGEL/2+LJK_ANGLE+BZK_ANGLE,
FDK_ANGEL/2+LJK_ANGLE+BZK_ANGLE*2,
FDK_ANGEL/2+LJK_ANGLE+BZK_ANGLE*3,
FDK_ANGEL/2+LJK_ANGLE*2+BZK_ANGLE*3];
# ----------------------------------------
formula = Formula("x/360")  # unwired: x
map = List.Map(list=code_block_20.out1, f_x=formula)
transpose_5 = List.Transpose(lists=map)
splitByParameter = Curve.SplitByParameter(curve=rotate, parameters=transpose_5)
transpose_6 = List.Transpose(lists=splitByParameter)
lastItem_3 = List.LastItem(list=transpose_6)
firstItem_3 = List.FirstItem(list=transpose_6)
join_4 = Curve.Join(curve=lastItem_3@L1, curves=firstItem_3@L1)
code_block_21 = CodeBlock { 1; }
dropItems_3 = List.DropItems(list=transpose_6, amount=code_block_21)
code_block_22 = CodeBlock { -1; }
dropItems_4 = List.DropItems(list=dropItems_3, amount=code_block_22)
join_5 = List.Join(list0=join_4, list1=dropItems_4)
flatten = List.Flatten(list=join_5)
code_block_23 = CodeBlock { 4; }
chop = List.Chop(list=flatten, lengths=code_block_23)
startPoint = Curve.StartPoint(curve=chop)
transpose_7 = List.Transpose(lists=startPoint)
code_block_24 = CodeBlock { 0.5; }
pointAtParameter = Curve.PointAtParameter(curve=chop, param=code_block_24)
transpose_8 = List.Transpose(lists=pointAtParameter)
endPoint = Curve.EndPoint(curve=chop)
transpose_9 = List.Transpose(lists=endPoint)
list_create_4 = List.Create(item0=transpose_7, item1=transpose_8, item2=transpose_9)
flatten_2 = List.Flatten(list=list_create_4)
code_block_25 = CodeBlock { 24; }
chop_2 = List.Chop(list=flatten_2, lengths=code_block_25)
transpose_10 = List.Transpose(lists=chop_2)
byPlaneRadius_2 = Circle.ByPlaneRadius(plane=planeAtParameter, radius=code_block_13)
code_block_26 = CodeBlock(d=FWJ) { d; }
rotate_2 = Geometry.Rotate(geometry=byPlaneRadius_2, basePlane=planeAtParameter, degrees=code_block_26)
code_block_27 = CodeBlock(FDK_ANGEL=FDK_L, LJK_ANGLE=LJK_L)  # same code as code_block_20
formula_2 = Formula("x/360")  # unwired: x
map_2 = List.Map(list=code_block_27.out1, f_x=formula_2)
transpose_11 = List.Transpose(lists=map_2)
splitByParameter_2 = Curve.SplitByParameter(curve=rotate_2, parameters=transpose_11)
transpose_12 = List.Transpose(lists=splitByParameter_2)
lastItem_4 = List.LastItem(list=transpose_12)
firstItem_4 = List.FirstItem(list=transpose_12)
join_6 = Curve.Join(curve=lastItem_4@L1, curves=firstItem_4@L1)
code_block_28 = CodeBlock { 1; }
dropItems_5 = List.DropItems(list=transpose_12, amount=code_block_28)
code_block_29 = CodeBlock { -1; }
dropItems_6 = List.DropItems(list=dropItems_5, amount=code_block_29)
join_7 = List.Join(list0=join_6, list1=dropItems_6)
flatten_3 = List.Flatten(list=join_7)
code_block_30 = CodeBlock { 4; }
chop_3 = List.Chop(list=flatten_3, lengths=code_block_30)
startPoint_2 = Curve.StartPoint(curve=chop_3)
transpose_13 = List.Transpose(lists=startPoint_2)
code_block_31 = CodeBlock { 0.5; }
pointAtParameter_2 = Curve.PointAtParameter(curve=chop_3, param=code_block_31)
transpose_14 = List.Transpose(lists=pointAtParameter_2)
endPoint_2 = Curve.EndPoint(curve=chop_3)
transpose_15 = List.Transpose(lists=endPoint_2)
list_create_5 = List.Create(item0=transpose_13, item1=transpose_14, item2=transpose_15)
flatten_4 = List.Flatten(list=list_create_5)
code_block_32 = CodeBlock { 24; }
chop_4 = List.Chop(list=flatten_4, lengths=code_block_32)
transpose_16 = List.Transpose(lists=chop_4)
parameterAtPoint_2 = Curve.ParameterAtPoint(curve=byPoints, point=join_3)
planeAtParameter_2 = Curve.PlaneAtParameter(curve=byPoints, param=parameterAtPoint_2)
code_block_33 = CodeBlock(R=code_block_13, TH=TH) { R+TH; }
byPlaneRadius_3 = Circle.ByPlaneRadius(plane=planeAtParameter_2, radius=code_block_33)
code_block_34 = CodeBlock(d=FWJ) { d; }
rotate_3 = Geometry.Rotate(geometry=byPlaneRadius_3, basePlane=planeAtParameter_2, degrees=code_block_34)
code_block_35 = CodeBlock { 13; }
FDK_R = List.GetItemAtIndex(list=transpose, index=code_block_35)
code_block_36 = CodeBlock { 15; }
LJK_R = List.GetItemAtIndex(list=transpose, index=code_block_36)
code_block_37 = CodeBlock(FDK_ANGEL=FDK_R, LJK_ANGLE=LJK_R)  # same code as code_block_20
formula_3 = Formula("x/360")  # unwired: x
map_3 = List.Map(list=code_block_37.out1, f_x=formula_3)
transpose_17 = List.Transpose(lists=map_3)
splitByParameter_3 = Curve.SplitByParameter(curve=rotate_3, parameters=transpose_17)
transpose_18 = List.Transpose(lists=splitByParameter_3)
lastItem_5 = List.LastItem(list=transpose_18)
firstItem_5 = List.FirstItem(list=transpose_18)
join_8 = Curve.Join(curve=lastItem_5@L1, curves=firstItem_5@L1)
code_block_38 = CodeBlock { 1; }
dropItems_7 = List.DropItems(list=transpose_18, amount=code_block_38)
code_block_39 = CodeBlock { -1; }
dropItems_8 = List.DropItems(list=dropItems_7, amount=code_block_39)
join_9 = List.Join(list0=join_8, list1=dropItems_8)
flatten_5 = List.Flatten(list=join_9)
code_block_40 = CodeBlock { 4; }
chop_5 = List.Chop(list=flatten_5, lengths=code_block_40)
startPoint_3 = Curve.StartPoint(curve=chop_5)
transpose_19 = List.Transpose(lists=startPoint_3)
code_block_41 = CodeBlock { 0.5; }
pointAtParameter_3 = Curve.PointAtParameter(curve=chop_5, param=code_block_41)
transpose_20 = List.Transpose(lists=pointAtParameter_3)
endPoint_3 = Curve.EndPoint(curve=chop_5)
transpose_21 = List.Transpose(lists=endPoint_3)
list_create_6 = List.Create(item0=transpose_19, item1=transpose_20, item2=transpose_21)
flatten_6 = List.Flatten(list=list_create_6)
code_block_42 = CodeBlock { 24; }
chop_6 = List.Chop(list=flatten_6, lengths=code_block_42)
transpose_22 = List.Transpose(lists=chop_6)
byPlaneRadius_4 = Circle.ByPlaneRadius(plane=planeAtParameter_2, radius=code_block_13)
code_block_43 = CodeBlock(d=FWJ) { d; }
rotate_4 = Geometry.Rotate(geometry=byPlaneRadius_4, basePlane=planeAtParameter_2, degrees=code_block_43)
code_block_44 = CodeBlock(FDK_ANGEL=FDK_R, LJK_ANGLE=LJK_R)  # same code as code_block_20
formula_4 = Formula("x/360")  # unwired: x
map_4 = List.Map(list=code_block_44.out1, f_x=formula_4)
transpose_23 = List.Transpose(lists=map_4)
splitByParameter_4 = Curve.SplitByParameter(curve=rotate_4, parameters=transpose_23)
transpose_24 = List.Transpose(lists=splitByParameter_4)
lastItem_6 = List.LastItem(list=transpose_24)
firstItem_6 = List.FirstItem(list=transpose_24)
join_10 = Curve.Join(curve=lastItem_6@L1, curves=firstItem_6@L1)
code_block_45 = CodeBlock { 1; }
dropItems_9 = List.DropItems(list=transpose_24, amount=code_block_45)
code_block_46 = CodeBlock { -1; }
dropItems_10 = List.DropItems(list=dropItems_9, amount=code_block_46)
join_11 = List.Join(list0=join_10, list1=dropItems_10)
flatten_7 = List.Flatten(list=join_11)
code_block_47 = CodeBlock { 4; }
chop_7 = List.Chop(list=flatten_7, lengths=code_block_47)
startPoint_4 = Curve.StartPoint(curve=chop_7)
transpose_25 = List.Transpose(lists=startPoint_4)
code_block_48 = CodeBlock { 0.5; }
pointAtParameter_4 = Curve.PointAtParameter(curve=chop_7, param=code_block_48)
transpose_26 = List.Transpose(lists=pointAtParameter_4)
endPoint_4 = Curve.EndPoint(curve=chop_7)
transpose_27 = List.Transpose(lists=endPoint_4)
list_create_7 = List.Create(item0=transpose_25, item1=transpose_26, item2=transpose_27)
flatten_8 = List.Flatten(list=list_create_7)
code_block_49 = CodeBlock { 24; }
chop_8 = List.Chop(list=flatten_8, lengths=code_block_49)
transpose_28 = List.Transpose(lists=chop_8)

# group: <生成隧道>
python_script = Python(IN[0]=transpose_10, IN[1]=transpose_16, IN[2]=transpose_22, IN[3]=transpose_28)
# ---------- python_script.python (28 lines) ----------
# 加载 Python Standard 和 DesignScript 库
import sys
import clr
clr.AddReference('ProtoGeometry')
from Autodesk.DesignScript.Geometry import *

clr.AddReference('DSCoreNodes')
from DSCore import *


# 该节点的输入内容将存储为 IN 变量中的一个列表。
dataEnteringNode = IN
list1=IN[0]
list2=IN[1]
list3=IN[2]
list4=IN[3]
# 将代码放在该行下面
count=List.Count(list1)
i=0
result=[]
while i < count:
    result.append(list1[i])
    result.append(list2[i])
    result.append(list3[i])
    result.append(list4[i])
    i=i+1
# 将输出内容指定给 OUT 变量。
OUT = result
# ----------------------------------------
flatten_9 = List.Flatten(list=python_script)
code_block_50 = CodeBlock { 12; }
chop_9 = List.Chop(list=flatten_9, lengths=code_block_50)
family_types = FamilyTypes("自适应管片:自适应管片")
byPoints_2 = AdaptiveComponent.ByPoints(points=chop_9, familyType=family_types)

轴线 = CodeBlock(point=join) { point; }
code_block_51 = CodeBlock { -1; }
dropItems_11 = List.DropItems(list=轴线, amount=code_block_51)
code_block_52 = CodeBlock { 1; }
dropItems_12 = List.DropItems(list=轴线, amount=code_block_52)
byTwoPoints_3 = Vector.ByTwoPoints(start=dropItems_11, end=dropItems_12)
code_block_53 = CodeBlock { 16; }
getitematindex = List.GetItemAtIndex(list=transpose, index=code_block_53)
string_from_array = FromArray(arr=getitematindex)
string_2 = StringInput("NaN")
string_3 = StringInput("0")
replace = String.Replace(str=string_from_array, searchFor=string_2, replaceWith=string_3)
code_block_54 = CodeBlock { 0; }
code_block_55 = CodeBlock { 1; }
remove = String.Remove(str=replace, startIndex=code_block_54, count=code_block_55)
length = String.Length(str=remove)
code_block_56 = CodeBlock(n=length) { n-1; }
code_block_57 = CodeBlock { 1; }
remove_2 = String.Remove(str=remove, startIndex=code_block_56, count=code_block_57)
string_4 = StringInput(";")
string_5 = StringInput(",")
split = String.Split(str=remove_2, separator0=string_4, separator1=string_5)
toNumber = String.ToNumber(str=split)
code_block_58 = CodeBlock { 6; }
chop_10 = List.Chop(list=toNumber, lengths=code_block_58)
code_block_59 = CodeBlock(a=byTwoPoints_3, Delta=chop_10) { b = a.Normalized(); c=b.Scale(Delta); }
flatten_10 = List.Flatten(list=code_block_59.c)
list_create_8 = List.Create(item0=flatten_10, item1=flatten_10, item2=flatten_10)
transpose_29 = List.Transpose(lists=list_create_8)
add_3 = Point.Add(point=transpose_16, vectorToAdd=transpose_29)
add_4 = Point.Add(point=transpose_10, vectorToAdd=transpose_29)
add_5 = Point.Add(point=transpose_28, vectorToAdd=transpose_29)
add_6 = Point.Add(point=transpose_22, vectorToAdd=transpose_29)
