# Dynamo custom node segmentation.dyf (Dynamo 2.5.0.7460)
# category: MyTunnel
# 对圆环进行分割，得到分割节点

curves = Input(curves: var[]..[])
plane = Input(plane: Autodesk.DesignScript.Geometry.Plane)
degrees = Input(degrees: double)
code_block = CodeBlock(d=degrees) { d; }
rotate = Geometry.Rotate(geometry=curves, basePlane=plane, degrees=code_block)
FDK_ANGEL = Input(FDK_ANGEL: var[]..[])
LJK_ANGLE = Input(LJK_ANGLE: var[]..[])
code_block_2 = CodeBlock(FDK_ANGEL=FDK_ANGEL, LJK_ANGLE=LJK_ANGLE)
# ---------- code_block_2.designscript (7 lines) ----------
BZK_ANGLE=(360-FDK_ANGEL-2*LJK_ANGLE)/3;
[FDK_ANGEL/2,
FDK_ANGEL/2+LJK_ANGLE,
FDK_ANGEL/2+LJK_ANGLE+BZK_ANGLE,
FDK_ANGEL/2+LJK_ANGLE+BZK_ANGLE*2,
FDK_ANGEL/2+LJK_ANGLE+BZK_ANGLE*3,
FDK_ANGEL/2+LJK_ANGLE*2+BZK_ANGLE*3];
# ----------------------------------------
formula = Formula("x/360")  # unwired: x
map = List.Map(list=code_block_2.out1, f_x=formula)
transpose = List.Transpose(lists=map)
splitByParameter = Curve.SplitByParameter(curve=rotate, parameters=transpose)
transpose_2 = List.Transpose(lists=splitByParameter)
lastItem = List.LastItem(list=transpose_2)
firstItem = List.FirstItem(list=transpose_2)
join = Curve.Join(curve=lastItem@L1, curves=firstItem@L1)
code_block_3 = CodeBlock { 1; }
dropItems = List.DropItems(list=transpose_2, amount=code_block_3)
code_block_4 = CodeBlock { -1; }
dropItems_2 = List.DropItems(list=dropItems, amount=code_block_4)
join_2 = List.Join(list0=join, list1=dropItems_2)
flatten = List.Flatten(list=join_2)
code_block_5 = CodeBlock { 4; }
chop = List.Chop(list=flatten, lengths=code_block_5)
startPoint = Curve.StartPoint(curve=chop)
transpose_3 = List.Transpose(lists=startPoint)
code_block_6 = CodeBlock { 0.5; }
pointAtParameter = Curve.PointAtParameter(curve=chop, param=code_block_6)
transpose_4 = List.Transpose(lists=pointAtParameter)
endPoint = Curve.EndPoint(curve=chop)
transpose_5 = List.Transpose(lists=endPoint)
list_create = List.Create(item0=transpose_3, item1=transpose_4, item2=transpose_5)
flatten_2 = List.Flatten(list=list_create)
code_block_7 = CodeBlock { 24; }
chop_2 = List.Chop(list=flatten_2, lengths=code_block_7)
transpose_6 = List.Transpose(lists=chop_2)
lists = Output(transpose_6)
